# Grasshopper definition Cpython_mintToken.gh (Grasshopper 1.0.7)
# plug-ins: GH_CPython

python = GhPythonScript()  # -> Out, A
panel = Panel("""<?xml version="1.0" encoding="utf-8" standalone="yes"?>
<Archive name="Root">
  <!--Grasshopper archive-->
  <!--Grasshopper and GH_IO.dll are copyrighted by Robert McNeel & Associates-->
  <!--Archive generated by GH_IO.dll file utility library {0.2.0002}-->
  <items count="1">
    <item name="ArchiveVersion" type_name="gh_version" type_code="80">
      <Major>0</Major>
      <Minor>2</Minor>
      <Revision>2</Revision>
    </item>
  </items>
  <chunks count="1">
    <chunk name="Clipboard">
      <items count="1">
        <item name="plugin_version" type_name="gh_version" type_code="80">
          <Major>1</Major>
          <Minor>0</Minor>
          <Revision>7</Revision>
        </item>
      </items>
      <chunks count="5">
        <chunk name="DocumentHeader">
          <items count="5">
            <item name="DocumentID" type_name="gh_guid" type_code="9">76ec933e-3a66-4fe9-91e3-356b35050cfd</item>
            <item name="Preview" type_name="gh_string" type_code="10">Shaded</item>
            <item name="PreviewMeshType" type_name="gh_int32" type_code="3">1</item>
            <item name="PreviewNormal" type_name="gh_drawing_color" type_code="36">
              <ARGB>100;150;0;0</ARGB>
            </item>
            <item name="PreviewSelected" type_name="gh_drawing_color" type_code="36">
              <ARGB>100;0;150;0</ARGB>
            </item>
          </items>
        </chunk>
        <chunk name="DefinitionProperties">
          <items count="3">
            <item name="Date" type_name="gh_date" type_code="8">637536707525014065</item>
            <item name="Description" type_name="gh_string" type_code="10"></item>
            <item name="Name" type_name="gh_string" type_code="10">test.gh</item>
          </items>
          <chunks count="3">
            <chunk name="Revisions">
              <items count="1">
                <item name="RevisionCount" type_name="gh_int32" type_code="3">0</item>
              </items>
            </chunk>
            <chunk name="Projection">
              <items count="2">
                <item name="Target" type_name="gh_drawing_point" type_code="30">
                  <X>-396</X>
                  <Y>0</Y>
                </item>
                <item name="Zoom" type_name="gh_single" type_code="5">1.62833309</item>
              </items>
            </chunk>
            <chunk name="Views">
              <items count="1">
                <item name="ViewCount" type_name="gh_int32" type_code="3">0</item>
              </items>
            </chunk>
          </chunks>
        </chunk>
        <chunk name="RcpLayout">
          <items count="1">
            <item name="GroupCount" type_name="gh_int32" type_code="3">0</item>
          </items>
        </chunk>
        <chunk name="GHALibraries">
          <items count="1">
            <item name="Count" type_name="gh_int32" type_code="3">0</item>
          </items>
        </chunk>
        <chunk name="DefinitionObjects">
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""")
panel_2 = Panel("v= 80 80 80")
mint_token = Mint_Token()  # -> output; inputs y: list, x: list
#   port output: indicate your output description here. refers to a new line.
# ---------- mint_token: Python ----------
# -*- coding: utf-8 -*-
"""
Python Script
Created on  Saturday April 2021 05:01:37 
@author:  calys 

[desc]
connector to a smart contract to mint tokens
[/desc]
"""


#refer to credentials.MD for public test ethereum addrsses
#double check that this is my infura.
#double check that all addresses are written with capitals so they CheckSum

contract_address = "0xCb32C5E0D5ea5dEc1d6D5B2624eEEc35b8cf302c" #contract owned by ArchChainONE
wallet_address = "0x59DcC1e1B1F43BaD14DA3b8040995677d6fc923E"
address = "0x59DcC1e1B1F43BaD14DA3b8040995677d6fc923E"
wallet_private_key = "2366b847b1452a873139138443b88957f084e4add05f00d3074497ed404db0d0"
infura_url = "https://ropsten.infura.io/v3/029c7ec526724b59b345469899f0dd9e" #Theo's infura Node

#infura_url = "https://ropsten.infura.io/v3/bc0151acb1204cacadd049ab3ac000eb" #Wassim's infura node

#@dev: entries to use with the anaconda python inside blender/dynamo/Grrasshopper
#@dev: testt initially without topologic, jusst send a strring to be minted,
#path = "/opt/anaconda3/lib/python3.8/site-packages" #enter your web3 location here - This is the macosx version
path = "c:\\Users\\calys\\anaconda3\\envs\\Dynamo383\\Lib\\site-packages" #enter your web3 location here - This is the windows version
contract_abi =  "[{\"inputs\":[],\"stateMutability\":\"nonpayable\",\"type\":\"constructor\"},{\"anonymous\":false,\"inputs\":[{\"indexed\":true,\"internalType\":\"address\",\"name\":\"owner\",\"type\":\"address\"},{\"indexed\":true,\"internalType\":\"address\",\"name\":\"approved\",\"type\":\"address\"},{\"indexed\":true,\"internalType\":\"uint256\",\"name\":\"tokenId\",\"type\":\"uint256\"}],\"name\":\"Approval\",\"type\":\"event\"},{\"anonymous\":false,\"inputs\":[{\"indexed\":true,\"internalType\":\"address\",\"name\":\"owner\",\"type\":\"address\"},{\"indexed\":true,\"internalType\":\"address\",\"name\":\"operator\",\"type\":\"address\"},{\"indexed\":false,\"internalType\":\"bool\",\"name\":\"approved\",\"type\":\"bool\"}],\"name\":\"ApprovalForAll\",\"type\":\"event\"},{\"anonymous\":false,\"inputs\":[{\"indexed\":true,\"internalType\":\"address\",\"name\":\"previousOwner\",\"type\":\"address\"},{\"indexed\":true,\"internalType\":\"address\",\"name\":\"newOwner\",\"type\":\"address\"}],\"name\":\"OwnershipTransferred\",\"type\":\"event\"},{\"anonymous\":false,\"inputs\":[{\"indexed\":true,\"internalType\":\"address\",\"name\":\"from\",\"type\":\"address\"},{\"indexed\":true,\"internalType\":\"address\",\"name\":\"to\",\"type\":\"address\"},{\"indexed\":true,\"internalType\":\"uint256\",\"name\":\"tokenId\",\"type\":\"uint256\"}],\"name\":\"Transfer\",\"type\":\"event\"},{\"inputs\":[{\"internalType\":\"address\",\"name\":\"to\",\"type\":\"address\"},{\"internalType\":\"uint256\",\"name\":\"tokenId\",\"type\":\"uint256\"}],\"name\":\"approve\",\"outputs\":[],\"stateMutability\":\"nonpayable\",\"type\":\"function\"},{\"inputs\":[{\"internalType\":\"address\",\"name\":\"owner\",\"type\":\"address\"}],\"name\":\"balanceOf\",\"outputs\":[{\"internalType\":\"uint256\",\"name\":\"\",\"type\":\"uint256\"}],\"stateMutability\":\"view\",\"type\":\"function\"},{\"inputs\":[],\"name\":\"baseURI\",\"outputs\":[{\"internalType\":\"string\",\"name\":\"\",\"type\":\"string\"}],\"stateMutability\":\"view\",\"type\":\"function\"},{\"inputs\":[{\"internalType\":\"uint256\",\"name\":\"tokenId\",\"type\":\"uint256\"}],\"name\":\"getApproved\",\"outputs\":[{\"internalType\":\"address\",\"name\":\"\",\"type\":\"address\"}],\"stateMutability\":\"view\",\"type\":\"function\"},{\"inputs\":[{\"internalType\":\"address\",\"name\":\"owner\",\"type\":\"address\"},{\"internalType\":\"address\",\"name\":\"operator\",\"type\":\"address\"}],\"name\":\"isApprovedForAll\",\"outputs\":[{\"internalType\":\"bool\",\"name\":\"\",\"type\":\"bool\"}],\"stateMutability\":\"view\",\"type\":\"function\"},{\"inputs\":[{\"internalType\":\"address\",\"name\":\"recipient\",\"type\":\"address\"},{\"internalType\":\"string\",\"name\":\"tokenURI\",\"type\":\"string\"}],\"name\":\"mintNFT\",\"outputs\":[{\"internalType\":\"uint256\",\"name\":\"\",\"type\":\"uint256\"}],\"stateMutability\":\"nonpayable\",\"type\":\"function\"},{\"inputs\":[],\"name\":\"name\",\"outputs\":[{\"internalType\":\"string\",\"name\":\"\",\"type\":\"string\"}],\"stateMutability\":\"view\",\"type\":\"function\"},{\"inputs\":[],\"name\":\"owner\",\"outputs\":[{\"internalType\":\"address\",\"name\":\"\",\"type\":\"address\"}],\"stateMutability\":\"view\",\"type\":\"function\"},{\"inputs\":[{\"internalType\":\"uint256\",\"name\":\"tokenId\",\"type\":\"uint256\"}],\"name\":\"ownerOf\",\"outputs\":[{\"internalType\":\"address\",\"name\":\"\",\"type\":\"address\"}],\"stateMutability\":\"view\",\"type\":\"function\"},{\"inputs\":[],\"name\":\"renounceOwnership\",\"outputs\":[],\"stateMutability\":\"nonpayable\",\"type\":\"function\"},{\"inputs\":[{\"internalType\":\"address\",\"name\":\"from\",\"type\":\"address\"},{\"internalType\":\"address\",\"name\":\"to\",\"type\":\"address\"},{\"internalType\":\"uint256\",\"name\":\"tokenId\",\"type\":\"uint256\"}],\"name\":\"safeTransferFrom\",\"outputs\":[],\"stateMutability\":\"nonpayable\",\"type\":\"function\"},{\"inputs\":[{\"internalType\":\"address\",\"name\":\"from\",\"type\":\"address\"},{\"internalType\":\"address\",\"name\":\"to\",\"type\":\"address\"},{\"internalType\":\"uint256\",\"name\":\"tokenId\",\"type\":\"uint256\"},{\"internalType\":\"bytes\",\"name\":\"_data\",\"type\":\"bytes\"}],\"name\":\"safeTransferFrom\",\"outputs\":[],\"stateMutability\":\"nonpayable\",\"type\":\"function\"},{\"inputs\":[{\"internalType\":\"address\",\"name\":\"operator\",\"type\":\"address\"},{\"internalType\":\"bool\",\"name\":\"approved\",\"type\":\"bool\"}],\"name\":\"setApprovalForAll\",\"outputs\":[],\"stateMutability\":\"nonpayable\",\"type\":\"function\"},{\"inputs\":[{\"internalType\":\"bytes4\",\"name\":\"interfaceId\",\"type\":\"bytes4\"}],\"name\":\"supportsInterface\",\"outputs\":[{\"internalType\":\"bool\",\"name\":\"\",\"type\":\"bool\"}],\"stateMutability\":\"view\",\"type\":\"function\"},{\"inputs\":[],\"name\":\"symbol\",\"outputs\":[{\"internalType\":\"string\",\"name\":\"\",\"type\":\"string\"}],\"stateMutability\":\"view\",\"type\":\"function\"},{\"inputs\":[{\"internalType\":\"uint256\",\"name\":\"index\",\"type\":\"uint256\"}],\"name\":\"tokenByIndex\",\"outputs\":[{\"internalType\":\"uint256\",\"name\":\"\",\"type\":\"uint256\"}],\"stateMutability\":\"view\",\"type\":\"function\"},{\"inputs\":[{\"internalType\":\"address\",\"name\":\"owner\",\"type\":\"address\"},{\"internalType\":\"uint256\",\"name\":\"index\",\"type\":\"uint256\"}],\"name\":\"tokenOfOwnerByIndex\",\"outputs\":[{\"internalType\":\"uint256\",\"name\":\"\",\"type\":\"uint256\"}],\"stateMutability\":\"view\",\"type\":\"function\"},{\"inputs\":[{\"internalType\":\"uint256\",\"name\":\"tokenId\",\"type\":\"uint256\"}],\"name\":\"tokenURI\",\"outputs\":[{\"internalType\":\"string\",\"name\":\"\",\"type\":\"string\"}],\"stateMutability\":\"view\",\"type\":\"function\"},{\"inputs\":[],\"name\":\"totalSupply\",\"outputs\":[{\"internalType\":\"uint256\",\"name\":\"\",\"type\":\"uint256\"}],\"stateMutability\":\"view\",\"type\":\"function\"},{\"inputs\":[{\"internalType\":\"address\",\"name\":\"from\",\"type\":\"address\"},{\"internalType\":\"address\",\"name\":\"to\",\"type\":\"address\"},{\"internalType\":\"uint256\",\"name\":\"tokenId\",\"type\":\"uint256\"}],\"name\":\"transferFrom\",\"outputs\":[],\"stateMutability\":\"nonpayable\",\"type\":\"function\"},{\"inputs\":[{\"internalType\":\"address\",\"name\":\"newOwner\",\"type\":\"address\"}],\"name\":\"transferOwnership\",\"outputs\":[],\"stateMutability\":\"nonpayable\",\"type\":\"function\"}]"



import time
import sys
sys.path.append(path)
from web3 import Web3, HTTPProvider


#from topologic import Vertex, Topology
#import cppyy


#v = Vertex.ByCoordinates(10,20,30)
string = str('_input')

w3 = Web3(HTTPProvider(infura_url))


smartContract = w3.eth.contract(address=contract_address, abi=contract_abi)

receipts = []

#the next function call mints the NFT
nonce = w3.eth.get_transaction_count(wallet_address)
tx_dict = smartContract.functions.mintNFT(address, string).buildTransaction({
    'chainId' : 3,
    'gas' : 2100000,  #some of this was throwing errors, double check gas amounts.
    'gasPrice' : w3.toWei('50', 'gwei'),
    'nonce' : nonce,
})



signed_tx = w3.eth.account.sign_transaction(tx_dict, wallet_private_key)
tx_hash = w3.eth.send_raw_transaction(signed_tx.rawTransaction)
tx_receipt = w3.eth.waitForTransactionReceipt(tx_hash, timeout=120, poll_latency=0.1)
receipts.append(tx_receipt)



outputList = []
for tx_receipt in receipts:
    receipt = []
    receipt.append('blockHash: '+str(tx_receipt['blockHash']))
    receipt.append('blockNumber: '+str(tx_receipt['blockNumber']))
    receipt.append('contractAddress: '+str(tx_receipt['contractAddress']))
    receipt.append('cumulativeGasUsed: '+str(tx_receipt['cumulativeGasUsed']))
    receipt.append('from: '+str(tx_receipt['from']))
    receipt.append('gasUsed: '+str(tx_receipt['gasUsed']))
    receipt.append('logs: '+str(tx_receipt['logs']))
    receipt.append('to: '+str(tx_receipt['to']))
    receipt.append('transactionHash: '+str(tx_receipt['transactionHash']))
    receipt.append('tansactionIndex: '+str(tx_receipt['transactionIndex']))
    outputList.append(receipt)



print(outputList)
# ---------- end mint_token ----------
