# Dynamo graph Topologic-04-Tutorial02_tower_python_mint.dyn (Dynamo 2.11.0.4533)
# packages: Topologic 1.4.0

code_block = CodeBlock { -10; -10; 0; 10; 10; 60; }
byCoordinates = Point.ByCoordinates(x=code_block.out0, y=code_block.out1, z=code_block.out2)
byCoordinates_2 = Point.ByCoordinates(x=code_block.out3, y=code_block.out4, z=code_block.out5)
byCorners = Cuboid.ByCorners(lowPoint=byCoordinates, highPoint=byCoordinates_2)
byGeometry = Topologic.Topology.ByGeometry(geometry=byCorners)
code_block_2 = CodeBlock { 30; 30; }
byWidthLength = Rectangle.ByWidthLength(width=code_block_2.out0, length=code_block_2.out1)
code_block_3 = CodeBlock { 0; 0; 10..50..10; }
translate = Geometry.Translate(geometry=byWidthLength, xTranslation=code_block_3.out0, yTranslation=code_block_3.out1, zTranslation=code_block_3.out2)
byGeometry_2 = Topologic.Topology.ByGeometry(geometry=translate)
byWire = Topologic.Face.ByWire(wire=byGeometry_2)
byTopologies = Topologic.Cluster.ByTopologies(topologies=byWire)
slice = Topologic.Topology.Slice(topology=byGeometry, tool=byTopologies)
code_block_4 = CodeBlock { -5; -5; 0; 5; 5; 60; }
byCoordinates_3 = Point.ByCoordinates(x=code_block_4.out0, y=code_block_4.out1, z=code_block_4.out2)
byCoordinates_4 = Point.ByCoordinates(x=code_block_4.out3, y=code_block_4.out4, z=code_block_4.out5)
byCorners_2 = Cuboid.ByCorners(lowPoint=byCoordinates_3, highPoint=byCoordinates_4)
byGeometry_3 = Topologic.Topology.ByGeometry(geometry=byCorners_2)
impose = Topologic.Topology.Impose(topology=slice, tool=byGeometry_3)
code_block_5 = CodeBlock { 10; 10; 0; 5; 5; 0; 5; 5; 60; 10; 10; 60; }
byCoordinates_5 = Point.ByCoordinates(x=code_block_5.out0, y=code_block_5.out1, z=code_block_5.out2)
byCoordinates_6 = Point.ByCoordinates(x=code_block_5.out3, y=code_block_5.out4, z=code_block_5.out5)
byCoordinates_7 = Point.ByCoordinates(x=code_block_5.out6, y=code_block_5.out7, z=code_block_5.out8)
byCoordinates_8 = Point.ByCoordinates(x=code_block_5.out9, y=code_block_5.out10, z=code_block_5.out11)
list_create = List.Create(item0=byCoordinates_5, item1=byCoordinates_6, item2=byCoordinates_7, item3=byCoordinates_8)
byPerimeterPoints = Surface.ByPerimeterPoints(points=list_create)
byGeometry_4 = Topologic.Topology.ByGeometry(geometry=byPerimeterPoints)
code_block_6 = CodeBlock { -10; -10; 0; -5; -5; 0; -5; -5; 60; -10; -10; 60; }
byCoordinates_9 = Point.ByCoordinates(x=code_block_6.out0, y=code_block_6.out1, z=code_block_6.out2)
byCoordinates_10 = Point.ByCoordinates(x=code_block_6.out3, y=code_block_6.out4, z=code_block_6.out5)
byCoordinates_11 = Point.ByCoordinates(x=code_block_6.out6, y=code_block_6.out7, z=code_block_6.out8)
byCoordinates_12 = Point.ByCoordinates(x=code_block_6.out9, y=code_block_6.out10, z=code_block_6.out11)
list_create_2 = List.Create(item0=byCoordinates_9, item1=byCoordinates_10, item2=byCoordinates_11, item3=byCoordinates_12)
byPerimeterPoints_2 = Surface.ByPerimeterPoints(points=list_create_2)
byGeometry_5 = Topologic.Topology.ByGeometry(geometry=byPerimeterPoints_2)
code_block_7 = CodeBlock { -10; 10; 0; -5; 5; 0; -5; 5; 60; -10; 10; 60; }
byCoordinates_13 = Point.ByCoordinates(x=code_block_7.out0, y=code_block_7.out1, z=code_block_7.out2)
byCoordinates_14 = Point.ByCoordinates(x=code_block_7.out3, y=code_block_7.out4, z=code_block_7.out5)
byCoordinates_15 = Point.ByCoordinates(x=code_block_7.out6, y=code_block_7.out7, z=code_block_7.out8)
byCoordinates_16 = Point.ByCoordinates(x=code_block_7.out9, y=code_block_7.out10, z=code_block_7.out11)
list_create_3 = List.Create(item0=byCoordinates_13, item1=byCoordinates_14, item2=byCoordinates_15, item3=byCoordinates_16)
byPerimeterPoints_3 = Surface.ByPerimeterPoints(points=list_create_3)
byGeometry_6 = Topologic.Topology.ByGeometry(geometry=byPerimeterPoints_3)
code_block_8 = CodeBlock { 10; -10; 0; 5; -5; 0; 5; -5; 60; 10; -10; 60; }
byCoordinates_17 = Point.ByCoordinates(x=code_block_8.out0, y=code_block_8.out1, z=code_block_8.out2)
byCoordinates_18 = Point.ByCoordinates(x=code_block_8.out3, y=code_block_8.out4, z=code_block_8.out5)
byCoordinates_19 = Point.ByCoordinates(x=code_block_8.out6, y=code_block_8.out7, z=code_block_8.out8)
byCoordinates_20 = Point.ByCoordinates(x=code_block_8.out9, y=code_block_8.out10, z=code_block_8.out11)
list_create_4 = List.Create(item0=byCoordinates_17, item1=byCoordinates_18, item2=byCoordinates_19, item3=byCoordinates_20)
byPerimeterPoints_4 = Surface.ByPerimeterPoints(points=list_create_4)
byGeometry_7 = Topologic.Topology.ByGeometry(geometry=byPerimeterPoints_4)
list_create_5 = List.Create(item0=byGeometry_4, item1=byGeometry_5, item2=byGeometry_6, item3=byGeometry_7)
byTopologies_2 = Topologic.Cluster.ByTopologies(topologies=list_create_5)
slice_2 = Topologic.Topology.Slice(topology=impose, tool=byTopologies_2)
geometry = Topologic.Topology.Geometry(topology=slice_2)
code_block_9 = CodeBlock { 100; 255; 0; 0; }
byARGB = Color.ByARGB(alpha=code_block_9.out0, red=code_block_9.out1, green=code_block_9.out2, blue=code_block_9.out3)
byGeometryColor = Modifiers.GeometryColor.ByGeometryColor(geometry=geometry, color=byARGB)
edges = Topologic.CellComplex.Edges(cellComplex=slice_2)
geometry_2 = Topologic.Topology.Geometry(topology=edges)
python_script = Python()  # CPython3; unwired: IN[0]; starter script, not edited (OUT = 0)
